vi "Parse Json.gvi"   [G Web Development Software 22.3.0]
inputs:
  "Data In": string
  "Error In": error
outputs:
  "Data Out": T2
  "Error Out": error
types:
  T1 = cluster{"LED1": bool, "LED2": bool, "LED3": bool, "LED4": bool, "BUZZ1": bool, "LED6": bool, "LED7": bool, "BUZZ2": bool}
  T2 = cluster{"path": string, "hum": f64, "temp": f64, "analog": f64, "rtd": f64, "LED": T1}
diagram:
  Unflatten From Json(JSON string=$"Data In", path=["type"], type and defaults=string "")
  Unflatten From Json(JSON string=$"Data In", path=["BUZZ2"], type and defaults=bool FALSE)
  Unflatten From Json(JSON string=$"Data In", path=["LED8"], type and defaults=bool FALSE)
  Unflatten From Json(JSON string=$"Data In", path=["LED9"], type and defaults=bool FALSE)
  Unflatten From Json(JSON string=$"Data In", error in (no error)=$"Error In", path=["path"], type and defaults=string "") -> (error out=w1, value=w2)
  Unflatten From Json(JSON string=$"Data In", path=["HUM"], type and defaults=f64 0) -> (value=w3)
  Unflatten From Json(JSON string=$"Data In", path=["TEMP"], type and defaults=f64 0) -> (value=w4)
  Unflatten From Json(JSON string=$"Data In", path=["RTD"], type and defaults=f64 0) -> (value=w5)
  # {"type": "data", "from": "('127.0.0.1', 59411)", "path": "/sensor/temp", "message": 1111}
  # {"type": "join_path", "status": "joined", "path": "/sensor/temp"}
  # {"type": "ping_host", "status": "ok", "ping": 0.21}
  Unflatten From Json(JSON string=$"Data In", path=["LED2"], type and defaults=bool FALSE) -> (value=w6)
  Unflatten From Json(JSON string=$"Data In", path=["LED3"], type and defaults=bool FALSE) -> (value=w7)
  Unflatten From Json(JSON string=$"Data In", path=["LED4"], type and defaults=bool FALSE) -> (value=w8)
  Unflatten From Json(JSON string=$"Data In", path=["BUZZ1"], type and defaults=bool FALSE) -> (value=w9)
  Unflatten From Json(JSON string=$"Data In", path=["LED6"], type and defaults=bool FALSE) -> (value=w10)
  Unflatten From Json(JSON string=$"Data In", path=["LED7"], type and defaults=bool FALSE) -> (value=w11)
  Unflatten From Json(JSON string=$"Data In", path=["BUZZ2"], type and defaults=bool FALSE) -> (value=w12)
  Unflatten From Json(JSON string=$"Data In", error in (no error)=$"Error In", path=["LED1"], type and defaults=bool FALSE) -> (error out=w13, value=w14)
  Property Node(instance in=T1 {all zero or empty}, "LED1"=w14, "LED2"=w6, "LED3"=w7, "LED4"=w8, "BUZZ1"=w9, "LED6"=w10, "LED7"=w11, "BUZZ2"=w12) -> (instance out=w15)
  Unflatten From Json(JSON string=$"Data In", path=["ANALOG"], type and defaults=f64 0) -> (value=w16)
  Property Node(instance in=T2 {all zero or empty}, "LED"=w15, "path"=w2, "hum"=w3, "temp"=w4, "analog"=w5, "rtd"=w16) -> (instance out=w17)
  $"Data Out" <- w17
  Merge Errors(w1, w13) -> (error out=w18)
  $"Error Out" <- w18
